% Simulink data dictionary Driver.sldd

DriverInitialGear = 0
DriverShiftTime = 0.1
DriverPositionGainR = 0.25
DriverDelayGain = 0.01
DriverFrontCornerStiff = 40000
DriverRearCornerStiff = 40000
DriverYawRateGain = 0.2
DriverPositionGainF = 6
DriverTractiveForce = 8000
DriverRollRes = 800
DriverDrivelineRes = 10
DriverWheelRange = 1.0472
DriverPreviewDist = 4
DriverAeroRes = 0.5
DriverTimeConst = 0.3