% Simulink data dictionary ElectricMachine2.sldd

PlntEM2TimeCnst = 0.02

PlntEM2EffTbl = [52 78 80 82 82 80 78 78 76 74 70
 52 78 80 82 82 80 78 78 76 74 70
 52 78 84 86 86 86 86 84 84 82 82
 52 80 86 86 88 88 88 86 86 84 84
 52 80 86 88 88 88 88 88 86 86 86
 52 80 86 88 90 90 90 90 88 88 88
 52 82 88 90 91 91 92 92 92 91 91
 52 82 88 91 91 92 93 93 93 93 93
 52 84 90 92 92 93 93 93 93 93 93
 62 86 91 93 93 93 93 93 93 93 93
 66 86 91 93 93 93 93 93 93 93 93
 70 86 92 93 93 93 93 93 93 93 93
 70 86 92 93 93 93 93 93 93 93 93
 72 86 91 93 93 93 93 93 93 93 93]

PlntEM2ExtSplySerRes = 0
PlntEM2RotDamp = 0.001
PlntEM2RotInertia = 0.01
PlntEM2RotInitSpd = 0
PlntEM2TrqLossTbl = repmat(0, 14, 11)
PlntEM2Spd = [0 113.4464 226.8928 289.8551 340.3392 453.7856 567.232 680.6784 794.1248 907.5712 1021.018 1134.464 1247.91 1361.357]
PlntEM2Trq = [144.9 144.9 144.9 144.9 123.4063 92.55472 74.04378 61.70315 52.88841 46.27736 41.13543 37.02189 33.65626 30.85157]
PlntEM2SpdEff = [0 113.4464 226.8928 289.8551 340.3392 453.7856 567.232 680.6784 794.1248 907.5712 1021.018 1134.464 1247.91 1361.357]
PlntEM2TrqEff = [0 14.49 28.98 43.47 57.96 72.45 86.94 101.43 115.92 130.41 144.9]
PlntEM2SpdLoss = [0 113.4464 226.8928 289.8551 340.3392 453.7856 567.232 680.6784 794.1248 907.5712 1021.018 1134.464 1247.91 1361.357]
PlntEM2TrqLoss = [0 14.49 28.98 43.47 57.96 72.45 86.94 101.43 115.92 130.41 144.9]