% Simulink data dictionary PassVeh.sldd

PlntVehMass = 1623
PlntWhlLongScaleFctr = 0.9
PlntWhlLongPeakFctr = 1
PlntWhlLongShapeFctr = 1.9
PlntWhlLnrVelForceComp = 0
PlntWhlQuadVelForceComp = 0
PlntWhlTirPrsExp = 0
PlntWhlNrmlForceExp = 1
PlntBrkFrntBias = 1
PlntBrkRearBias = 0.6
PlntBrkPrsFctr = 8000000
PlntWhlLongStfFctr = 10
PlntWhlLongCuvFctr = 0.97
PlntWhlVelIndpntForceCff = 0.01
PlntVehNumWhlFrntAxl = 2
PlntVehNumWhlRearAxl = 2
PlntVehDstCGFrntAxl = 1.09
PlntVehDstCGRearAxl = 1.7
PlntVehRollResCffa = 196
PlntVehRollResCffb = 2.232
PlntVehCGHgtAxl = 0.3
PlntVehInitLongVel = 0
PlntVehInitLatVel = 0
PlntVehInitVertVel = 0
PlntVehInitRollRate = 0
PlntVehInitPitchRate = 0
PlntVehInitYawRate = 0
PlntVehRollMomentInertia = 432.3333
PlntVehYawMomentInertia = 2066
PlntVehTrckWdth = [1.575 1.575]
PlntVehFrntUnsprgMass = 100
PlntVehRearUnsprgMass = 100
PlntSteerRackDispBpt = [-40 -19.2 -4.53 4.53 19.2 40]
PlntSteerGearRatio = 52.02477
PlntSteerLftWhlAngTbl = [-0.3490659 -0.1675516 -0.0395608 0.0395608 0.1675516 0.3490659]
PlntSteerRghtWhlAngTbl = [-0.3490659 -0.1675516 -0.0395608 0.0395608 0.1675516 0.3490659]
PlntSteerRange = 28.27433
PlntSteerPctAck = 100
PlntVehAeroFrntArea = 2.27
PlntVehAeroLiftCff = 0.1
PlntVehAeroPitchCff = 0.1
PlntSteerUpperInertia = 0.1
PlntSteerLowerInertia = 0.01
PlntSteerHysStiff = 30
PlntSteerWheelTrqBpt = [-100 0 100]
PlntSteerTrqAsstTbl = [0 -100; 0 0; 0 100]
PlntSpKCMotRatios = [1 1]
PlntSpKCBumpSteer = [0 0 0 0]
PlntSpKCBumpCamber = [0 0 0 0]
PlntSpKCBumpCaster = [0 0 0 0]
PlntSpKCLngWhlCtrDisp = [0 0 0 0]
PlntSpKCRollStiffArb = [0 0]
PlntSpKCRollStiffNoArb = [0 0]
PlntSpKCCambVsSteerAng = [0 0 0 0]
PlntSpKCCastVsSteerAng = [0 0 0 0]
PlntSpKCLngSteerCompl = repmat(0, 2, 4)
PlntSpKCLngCambCompl = repmat(0, 2, 4)
PlntSpKCLngCastCompl = repmat(0, 2, 4)
PlntSpKCLngWhlCtrCompl = repmat(0, 2, 4)
PlntSpKCLatSteerCompl = [0 0 0 0]
PlntSpKCLatCambCompl = [0 0 0 0]
PlntSpKCAlgnTrqSteerCompl = [0 0 0 0]
PlntSpKCAlgnTrqCambCompl = [0 0 0 0]
PlntSpStatLdWhlR = [0.3 0.3 0.3 0.3]
PlntSpMSStiffness = 52451.01
PlntSpMSPreload = 2886
PlntSpMSDamping = 5565.225
PlntSpMSMaxHeight = 0.25
PlntSpMSHeightVsSteer = 0.1432
PlntSpMSAntiSwayRadius = 0.2
PlntSpMSAntiSwayNeutralAngle = 0.5236
PlntSpMSAntiSwayTorsionStiffness = 800
PlntSpSARollInertia = 62.37452
PlntSpSAAxleMass = 160
PlntSpSAAxleWheelStiffness = 138031.6
PlntSpSAAxleWheelDamping = 11490.97
PlntSpSAAxleWheelPreload = 2907
PlntSpSAPreload = 2886
PlntSpSAStiffness = 52451.01
PlntSpSADamping = 5565.225
PlntSteerTrqLimit = 100
PlntSteerPwrLimit = 1000
PlntSteerWc = 200
PlntSpSAMaxHeight = 0.25
PlntSpMSStatCaster = 0
PlntSpMSStatCamber = 0
PlntSpMSStatToe = 0
PlntSpSAStatCaster = 0
PlntSpSAStatToe = 0
PlntSpKCStatCamber = [0 0 0 0]
PlntSpKCStatCaster = [0 0 0 0]
PlntSpKCStatToe = [0 0 0 0]
PlntSpSAStatCamber = 0
PlntSpKCLatWhlCtrComplLngBrk = repmat(0, 2, 4)
PlntSpKCLatWhlCtrComplLat = [0 0 0 0]
PlntBrkWc = 125.6637
PlntVehAeroDragCff = 0.389
PlntVehInitLongPos = 0
PlntVehInitRollAng = 0
PlntVehInitPitchAng = 0
PlntVehInitYawAng = 0
PlntSpKCNrmlWhlRates = [52.45101 52.45101 52.45101 52.45101]
PlntSpKCLatWhlCtrDisp = [0 0 0 0]
PlntSpKCNrmlWhlFrcOff = [2886 2886 2907 2907]
PlntSpKCShckFrcVsCompRate = [5.565225 5.565225 5.565225 5.565225]
PlntVehFzFlt = 10
PlntBrkStcFricCffRear = 0.45
PlntBrkSpoolRear = 50
PlntBrkPadMeanRadiusRear = 0.15
PlntBrkNumPadsRear = 2
PlntBrkKinFricCffRear = 0.35
PlntBrkActrBoreRear = 0.05
PlntBrkActrBoreFrnt = 0.05
PlntBrkKinFricCffFrnt = 0.35
PlntBrkNumPadsFrnt = 2
PlntBrkPadMeanRadiusFrnt = 0.15
PlntBrkSpoolFrnt = 50
PlntBrkStcFricCffFrnt = 0.45
PlntWhlDampCoeffRear = 0.001
PlntWhlInitAngVelRear = 0
PlntWhlDampCoeffFrnt = 0.001
PlntWhlRlxLngthLat = 0.15
PlntWhlMassFrnt = 11.2
PlntWhlMassRear = 11.2
PlntWhlLatStiff = 45000
PlntWhlCambStiff = 10000
PlntWhlStcFricCff = 0.8
PlntWhlKinFricCff = 0.5
PlntWhlVertDampCoeffRear = 1000
PlntWhlVertDampCoeffFrnt = 1000
PlntWhlInitAngVel = 0
PlntWhlRlxLngthFrnt = 0.1
PlntWhlRlxLngthRear = 0.1
PlntWhlRlxLngthLatFrnt = 0.1
PlntWhlRlxLngthLatRear = 0.1
PlntBrkBreakFricVelFrnt = 0.1
PlntBrkBreakFricVelRear = 0.1
PlntBrkViscFricFrnt = 0
PlntBrkViscFricRear = 0
PlntVeh3DOFFrntSuspDamp = 10000
PlntVeh3DOFFrntSuspStiff = 10000
PlntVeh3DOFRearSuspDamp = 10000
PlntVeh3DOFRearSuspStiff = 10000
PlntWhlInitVel = 0
PlntWhlVelThresh = 0.1
PlntWhlLongStiff = 500000
PlntWhlHubCompStiff = 1000000
PlntWhlHubCompDamp = 40000
PlntWhlRollResVelThresh = 0.1
PlntWhlCompDamp = 50000
PlntWhlCompStiff = 500000
PlntSteerSlgStf = 15000
PlntSteerUpprFric = 1
PlntSteerPrsFric = 1.0e-5
PlntSteerMaxStf = 10000
PlntSteerMaxUpprFric = 0.2
PlntSteerMaxDamp = 1
PlntSteerTorStf = 30
PlntSteerTorDamp = 1
PlntSteerKngpnOfst = 0.075
PlntSteerLambda = 0.2094395
PlntSteerHbLead = 4.0e-5
PlntSteerStcLdRadius = 0.4
PlntSteerStrgArmLngth = 0.1
PlntSteerTieRodLngth = 0.248
PlntSteerDst = 0.2
PlntSteerEpsilon = 0.9
PlntSteerPnInert = 0.1
PlntSteerRckCsLngth = 1.075
PlntSteerRckGn = 0.01
PlntVehHtchHgtAxl = 0
PlntVehHtchLatDst = 0
PlntVehHtchDst = 2.5
PlntWhlLongSpd = 16.7
PlntWhlNomPress = 220000
PlntWhlNomNorlForce = 4000
PlntVehInitVertPos = 0
PlntWhlVelTolLowVel = 1
PlntVehInitLatPos = 5.7
PlntSpKCRollCamber = [0 0]
PlntSpKCRollCaster = [0 0]
PlntSpKCRollSteer = [0 0]
PlntSpKCRollStiffArbFrnt = 0
PlntSpKCRollStiffNoArbFrnt = 0
PlntSpKCRollStiffNoTwstRear = 0
PlntSpKCVrtLdTrnsfr = [0 0 0 0]
PlntSteerRatio = 14
PlntWhlMaxSlipAngle = 1.5
PlntWhlMaxPress = 1000000
PlntWhlMinPress = 10000
PlntWhlMinSlipAngle = -1.5
PlntWhlMaxCmbr = 0.2
PlntWhlMinCmbr = -0.2
PlntWhlRimRadius = 0.1914
PlntWhlVertDampCoeff = [500 500 500 500]
PlntWhlMass = [9.4649 9.4649 9.4649 9.4649]
PlntWhlInertia = [0.74 0.74 0.74 0.74]
PlntWhlMinSlipRatio = -0.6
PlntWhlInertiaFrnt = 0.8
PlntWhlInertiaRear = 0.8

PlntWhlLdRadius = 0.327
PlntWhlUnldRadius = 0.336
PlntWhlMinFz = 100
PlntWhlMaxFz = 6570
PlntWhlMaxSlipRatio = 0.6
PlntWhlPrsFrnt = 220000
PlntWhlPrsRear = 220000
PlntWhlRlxLngth = 0.15
CtrlBcuTrlrBrkGain = 0
PlntWhlWidth = 0.205
PlntVehPitchMomentInertia = 1922.7
PlntWhlNumFrnt = 2
PlntWhlNumRear = 2